# Grasshopper definition load_robot_base.gh (Grasshopper 1.0.7)
# plug-ins: Pufferfish

# ---- group: useless
plane = Plane([PlaneXY(0, 0, 0), Plane(origin=(-395.9963408, 0.283952016, -2.781213324), x=(-0.9999904264, 0.00394134137, 0.001900789943), y=(-0.003906778167, -0.9998329213, 0.01785683404)), Plane(origin=(-890.5151125, 5.0922929, -2.626285744), x=(-0.9997437311, 0.008629085755, 0.02092871442), y=(-0.007889233104, -0.9993498656, 0.03517962623)), Plane(origin=(-1432.994889, 10.61324173, 11.29378643), x=(-0.999672067, 0.001040282927, 0.02558664415), y=(-0.0005438828781, -0.9998116532, 0.01940006157)), Plane(origin=(-1900.910799, 13.19450302, 30.73219911), x=(-0.9988224971, -0.0005586977315, 0.04851089629), y=(0.0007264687903, -0.9999938164, 0.003440857771)), Plane(origin=(-2403.727051, 11.33969824, 68.66773251), x=(-0.9960197182, -0.01391830769, 0.08803977292), y=(0.01206868045, -0.9996958616, -0.02150653999))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])  # disabled
ghpython_script = GhPythonScript(x=plane)  # -> out, a; inputs x: list of Plane; disabled
# ---------- ghpython_script: Python ----------
import Rhino.Geometry as rg

planes = []
planes.append(x[0])

for i in range(1, len(x)):
    plane = x[i].Clone()
    p_diff = x[i].Origin - planes[i-1].Origin
    if i < 7 or (i > 26 and i < 33):
        plane.OriginY = planes[i-1].OriginY
    else:
        plane.OriginX = planes[i-1].OriginX
    plane.OriginZ = 0.0
    if i == 27:
        plane.OriginX = planes[5].OriginX
    if i == 28:
        plane.OriginX = planes[4].OriginX
    if i == 29:
        plane.OriginX = planes[3].OriginX
    if i == 30:
        plane.OriginX = planes[2].OriginX
    if i == 31:
        plane.OriginX = planes[1].OriginX
    if i == 32:
        plane.OriginX = planes[0].OriginX
    planes.append(plane)

a = planes
# ---------- end ghpython_script ----------
unit_x = UnitX(Factor=1)  # disabled
deconstruct_plane = DeconstructPlane(Plane=ghpython_script.a)  # -> Origin, XAxis, YAxis, ZAxis; disabled
plane2matrix = Plane2matrix(target=ghpython_script.a)  # disabled
cross_product = CrossProduct(VectorA=deconstruct_plane.XAxis, VectorB=unit_x, Unitize=False)  # -> Vector, Length; disabled
deconstruct_matrix = DeconstructMatrix(Matrix=plane2matrix)  # -> Rows, Columns, Values; disabled
deconstruct_vector = DeconstructVector(Vector=cross_product.Vector)  # -> XComponent, YComponent, ZComponent; disabled
pt = Point([Point(0, 0, 0), Point(-397, 0, 0), Point(-891, 0, 0), Point(-1425, 0, 0), Point(-1894, 0, 0), Point(-2399, 0, 0)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])  # disabled
xy_plane = XYPlane(Origin=pt)  # disabled
arcsine = ArcSine(Value=deconstruct_vector.ZComponent)  # disabled
ghpython_script_2 = GhPythonScript(x=arcsine)  # -> out, a; inputs x: list; disabled
# ---------- ghpython_script_2: Python ----------
from math import pi

a = []

for i in range(len(x)):
    if x[i] < -0.75 * pi:
        a.append(-pi)
    elif x[i] < -0.25 * pi:
        a.append(-0.5*pi)
    elif x[i] < 0.25 * pi:
        a.append(0.0*pi)
    elif x[i] < 0.75 * pi:
        a.append(0.5*pi)
    else:
        a.append(pi)
# ---------- end ghpython_script_2 ----------
rotate_plane = RotatePlane(Plane=xy_plane, Angle=ghpython_script_2.a)  # disabled
deconstruct_plane_2 = DeconstructPlane(Plane=rotate_plane)  # -> Origin, XAxis, YAxis, ZAxis; disabled
panel = Panel(deconstruct_matrix.Values)  # disabled
ghpython_script_3 = GhPythonScript(p=deconstruct_plane_2.Origin, theta=ghpython_script_2.a)  # -> out; inputs p: list of Point3d, theta: list; disabled
# ---------- ghpython_script_3: Python ----------
for i in range(len(p)):
    print(("0.0 0.0 %.5f %.5f %.5f %.5f") % (theta[i], p[i].X * 0.001 , p[i].Y * 0.001 , p[i].Z * 0.001))
# ---------- end ghpython_script_3 ----------
panel_2 = Panel(ghpython_script_3)  # disabled

# ----
path = Panel("C:\Users\77777777\source\repos\digital_future\data_locate_base\")

# ---- group: camera
load_robot_base = GhPythonScript(path=path)  # -> out, rvec, tvec
# ---------- load_robot_base: Python ----------
#import ghpythonlib.treehelpers as th
import Rhino.Geometry as rg
import re

f = open(path+"w2c.txt")
lines = f.readlines()
rvec = []
tvec = []
count = -1

for line in lines:
    count += 1
    line = line.replace("  ", " ")
    line = line.replace("  ", " ")
    while line[0] == ' ':
        line = line[1:]
    nums = re.split(" ", line)
#    print nums
    rvec.append(rg.Point3d(float(nums[0]), float(nums[1]), float(nums[2])))
    tvec.append(rg.Point3d(float(nums[3]), float(nums[4]), float(nums[5]))*1000.0)
f.close()
# ---------- end load_robot_base ----------

# ---- group: wood
load_robot_base_2 = GhPythonScript(path=path)  # -> out, m
# ---------- load_robot_base_2: Python ----------
#import ghpythonlib.treehelpers as th
import Rhino.Geometry as rg
import re

f = open(path+"wood.txt")
lines = f.readlines()
m = []
count = -1

for line in lines:
    count += 1
    line = line.replace("  ", " ")
    line = line.replace("  ", " ")
    while line[0] == ' ':
        line = line[1:]
    nums = re.split(" ", line)
#    print nums
    m.append(rg.Point3d(float(nums[0]), float(nums[1]), float(nums[2])))
f.close()
# ---------- end load_robot_base_2 ----------

# ----
cluster = Cluster(vector=load_robot_base.rvec, vector_2=load_robot_base.tvec)
point = Point(load_robot_base_2.m)
polyline = PolyLine(Vertices=point, Closed=True)
curve = Curve([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])
list_length = ListLength(List=cluster)
plane_2 = Plane(cluster)
orient = Orient(Geometry=curve, Source=PlaneXY(0, 0, 0), Target=graft(plane_2))  # -> Geometry, Transform
series = Series(Start=0, Step=1, Count=list_length)
rotate_plane_2 = RotatePlane(Plane=plane_2, Angle=1.570796327)
custom_preview = CustomPreview(Geometry=orient.Geometry, Material=ColourSwatch(SwatchColor=RGB(8, 8, 8)))
flip_plane = FlipPlane(Plane=rotate_plane_2, FlipX=False, FlipY=False, FlipZ=True)  # -> Flipped, ResultBoolean
ghpython_script_4 = GhPythonScript(n="7")  # -> out; inputs n: Int32
# ---------- ghpython_script_4: Python ----------
for i in range(n):
    print ("MARKER_%02d") % i
# ---------- end ghpython_script_4 ----------
text_tag_3d = TextTag3D(Location=flip_plane.Flipped, Text=series, Size=30, Colour=RGB(56, 56, 56), Justification=5)
line = Line(Line((-232.5114191, 518.8239788, 730.6086581), (176.6922112, 506.9554951, 822.8006226)))
curve_middle = CurveMiddle(Curve=line)
length = Length(Curve=line)
unit_z = UnitZ(Factor=1)
construct_plane = ConstructPlane(Origin=curve_middle, XAxis=line, YAxis=unit_z)
text_tag_3d_2 = TextTag3D(Location=construct_plane, Text=length, Size=30, Justification=8)

# ---- group: ROBOT_BASE
load_robot_base_3 = GhPythonScript(path=path)  # -> out, m
# ---------- load_robot_base_3: Python ----------
f = open(path+"result.txt")
m = []
for _ in range(16):
    m.append(f.readline())
f.close()
# ---------- end load_robot_base_3 ----------

# ---- group: ROBOT_BASE / m to mm
ghpython_script_5 = GhPythonScript(x=load_robot_base_3.m)  # -> out, a; inputs x: list
# ---------- ghpython_script_5: Python ----------
a = []
for i in range(len(x)):
    if i == 3 or i == 7 or i == 11:
        a.append(1000.0*x[i])
    else:
        a.append(x[i])
# ---------- end ghpython_script_5 ----------

# ---- group: ROBOT_BASE (continued)
construct_matrix = ConstructMatrix(Rows="4", Columns="4", Values=ghpython_script_5.a)
pose2plane = Pose2plane(matrix=construct_matrix)

# ----
plane_3 = Plane(pose2plane)

# ---- group: MARKERS
load_markers = GhPythonScript(path=path, num="7")  # -> out, m; inputs num: Int32
# ---------- load_markers: Python ----------
import ghpythonlib.treehelpers as t

m = []
for i in range(num):
    m.append([])
    f = open(path+("w2k_%d.txt"%i))
    for _ in range(16):
        m[i].append(f.readline())
    f.close()
m = t.list_to_tree(m)
# ---------- end load_markers ----------

# ---- group: MARKERS / m to MM
ghpython_script_6 = GhPythonScript(x=load_markers.m)  # -> out, a; inputs x: list; same code as ghpython_script_5

# ---- group: MARKERS (continued)
construct_matrix_2 = ConstructMatrix(Rows="4", Columns="4", Values=ghpython_script_6.a)  # -> flatten(Matrix)
pose2plane_2 = Pose2plane(matrix=construct_matrix_2)  # -> flatten(plane)

# ----
plane_4 = Plane(pose2plane_2)

text_tag_3d_3 = TextTag3D(Location=plane_3, Text="ROBOT_BASE", Size=30, Justification=5)
construct_domain = ConstructDomain(DomainStart=expr("-0.5*x", "76.82"), DomainEnd=expr("0.5*x", "76.82"))
text_tag_3d_4 = TextTag3D(Location=plane_4, Text=ghpython_script_4, Size=30, Justification=5)
rectangle = Rectangle(Plane=plane_4, XSize=construct_domain, YSize=construct_domain, Radius=0)  # -> Rectangle, Length

# ==== cluster Pose2plane
matrix = ClusterInput()
deconstruct_matrix = DeconstructMatrix(Matrix=matrix)  # -> Rows, Columns, Values
panel = Panel("""3
7
11""")
panel_2 = Panel("""0
4
8""")
panel_3 = Panel("""1
5
9""")
list_item = ListItem(List=deconstruct_matrix.Values, Index=panel, Wrap=True)
list_item_2 = ListItem(List=deconstruct_matrix.Values, Index=panel_2, Wrap=True)
list_item_3 = ListItem(List=deconstruct_matrix.Values, Index=panel_3, Wrap=True)
list_item_4 = ListItem(List=list_item, Index=0, Wrap=True)  # -> Item, Item1, Item2
list_item_5 = ListItem(List=list_item_2, Index=0, Wrap=True)  # -> Item, Item1, Item2
list_item_6 = ListItem(List=list_item_3, Index=0, Wrap=True)  # -> Item, Item1, Item2
construct_point = ConstructPoint(XCoordinate=list_item_4.Item, YCoordinate=list_item_4.Item1, ZCoordinate=list_item_4.Item2)
vector_xyz = VectorXYZ(XComponent=list_item_5.Item, YComponent=list_item_5.Item1, ZComponent=list_item_5.Item2)  # -> Vector, Length
vector_xyz_2 = VectorXYZ(XComponent=list_item_6.Item, YComponent=list_item_6.Item1, ZComponent=list_item_6.Item2)  # -> Vector, Length
construct_plane = ConstructPlane(Origin=construct_point, XAxis=vector_xyz.Vector, YAxis=vector_xyz_2.Vector)
plane = ClusterOutput(construct_plane)

# ==== cluster Plane2matrix
xy_plane = XYPlane(Origin=Point(0, 0, 0))
target = ClusterInput()
orient = Orient(Source=xy_plane, Target=target)  # -> Geometry, Transform
matrix = Matrix(orient.Transform)
matrix_2 = ClusterOutput(matrix)

# ==== cluster Cluster
vector = ClusterInput()
vector_2 = ClusterInput()
vector_3 = Vector(vector)
vector_4 = Vector(vector_2)
vector_length = VectorLength(Vector=vector_3)
line_sdl = LineSDL(Start=Point(0, 0, 0), Direction=vector_3, Length=1)
rotate_axis = RotateAxis(Angle=vector_length, Axis=line_sdl)  # -> Geometry, graft(Transform)
move = Move(Motion=vector_4)  # -> Geometry, graft(Transform)
xy_plane = XYPlane(Origin=Point(0, 0, 0))
compound = Compound(Transforms=[rotate_axis.Transform, move.Transform])  # -> flatten(Compound)
inverse_transform = InverseTransform(Transform=compound)
transform = Transform(Geometry=xy_plane, Transform=inverse_transform)
geometry = ClusterOutput(transform)
